# Grasshopper definition Facade_Manager_GH_v0.3.gh (Grasshopper 1.0.7)

# ---- group: Development
ptuo = GHPythonToUserObject(Toggle=Toggle(False), LocalFolder="C:\Users\karimd\source\repos\FacadeManager\FM-Python", Category="FM-Python")  # -> TLOC; inputs Toggle: Boolean
# ---------- ptuo: Python ----------
"""
Iterates the GHPython components in the document and makes user objects of them
if the their Category property matches the input Category parameter. Also grabs
all the code and writes this to .py files.

    Input:
        Toggle: Activate the component using a boolean toggle {item,bool}
        Folder: The folder/directory to save the user objects and source code to {item,str}
        Category: The name of the category for which to make user objects {item,str}
    Output:
        TLOC: Lines of code in user object {item,int}
    Remarks:
        Author: Anders Holden Deleuran
        Contributor: Karim Daw
        License: Apache License 2.0
        Version: 250621
"""
ghenv.Component.Name = "GHPythonToUserObject"
ghenv.Component.NickName = "PTUO"
ghenv.Component.Category = "FM-Python"
ghenv.Component.SubCategory = "0-Dev"

import os
import Grasshopper as gh
import getpass

def ghPythonToUserObject(ghPyComp,writeFolder):
    
    """ 
    Automates the creation of a GHPython user object. Based on this thread:
    http://www.grasshopper3d.com/forum/topics/change-the-default-values-for-userobject-popup-menu
    """
    
    # Make a user object
    uo = gh.Kernel.GH_UserObject()
    
    # Set its properties based on the GHPython component properties
    uo.Icon = ghPyComp.Icon_24x24    
    uo.BaseGuid = ghPyComp.ComponentGuid
    uo.Exposure = ghenv.Component.Exposure.primary
    uo.Description.Name = ghPyComp.Name
    uo.Description.Description = ghPyComp.Description
    uo.Description.Category = ghPyComp.Category
    uo.Description.SubCategory = ghPyComp.SubCategory
    
    # Set the user object data and save to file
    uo.SetDataFromObject(ghPyComp)
    uo.Path = os.path.join(writeFolder,ghPyComp.Name+".ghuser")
    uo.SaveToFile()
    
    # Update the grasshopper ribbon UI (doesn't seem to work)
    #gh.Kernel.GH_ComponentServer.UpdateRibbonUI()

def exportGHPythonSource(ghPyComp,writeFolder):
    
    """ Export the source code of a GHPython component """
    
    # Get code and lines of code
    code = ghPyComp.Code
    code = code.replace("\r","")
    lines = code.splitlines()
    loc = len(lines)
    
    # Check/make source file folder
    srcFolder = os.path.join(writeFolder,"src")
    if not os.path.isdir(srcFolder):
        os.makedirs(srcFolder)
        
    # Write code to .py file
    srcFile = os.path.join(srcFolder,ghPyComp.Name + ".py")
    f = open(srcFile,"w")
    f.write(code)
    f.close()
    
    return loc

if Toggle and LocalFolder and Category:
    
    # Make GH component warning handler
    wh = gh.Kernel.GH_RuntimeMessageLevel.Warning
    
    # Get user name
    username=getpass.getuser()

    # get local GH componenet folder
    localGhFolder = "C:\Users\karimd\AppData\Roaming\Grasshopper\UserObjects"
 
    Folders = [LocalFolder,localGhFolder]
    
    # Iterate the canvas and get to the GHPython components
    TLOC = 0
    for obj in ghenv.Component.OnPingDocument().Objects:
        if type(obj) is type(ghenv.Component):
            
            # Check that category matches and export to files
            if obj.Category == Category:
                
                #loop through folders you want to save to
                for f in Folders:
                    ghPythonToUserObject(obj,f)
                    loc = exportGHPythonSource(obj,f)
                    TLOC += loc
                    obj.AddRuntimeMessage(wh,"I was just saved as a user object, hooray!")
# ---------- end ptuo ----------

# ----
brep = Brep([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])
ub = UncapBreps(CappedBreps=brep, OffsetDistance=Slider(0.5, range=0..12))  # -> out, VerticalSurfaces, TopSurface, BottomSurface; inputs CappedBreps: list
# ---------- ub: Python ----------
"""
Uncaps breps and return breps without top or bottom surfaces
-
    Args:
        CappedBreps: Breps to uncap {list,Breps}
        Tolerance: A number indicating the tolerance by which we cull the surfaces we dont want appearing {item,number}
    Returns:
        UnCappedBreps: List of uncapped Breps {list,Breps}
        TopSurface: Top surface as a Brep {item, Brep}
        BottomSurface: Bottom surface as a Brep {item, Brep}
    Remarks:
        Author: Karim Daw (BIG IDEAS)
        Project: EDUES
        License:
        Version: 250604001
"""

# Give your component a unique name and nickname (portrayed on the canvas).
ghenv.Component.Name = "UncapBreps"
ghenv.Component.NickName = "UB"

# Keep it in the "Performing" tab
ghenv.Component.Category = "FM-Python"

# Define the subcategory
ghenv.Component.SubCategory = "1-Utilities"

import time
import math
import Rhino
import Grasshopper as gh


# If you want to give the component a version number etc.
ghenv.Component.Message = time.strftime("%d/%m/%Y") + "\n" + time.strftime("%H:%M:%S")

def unCapBrep(brep,tol):
    
    verticalSurfaces = []
    bottomSurface = Rhino.Geometry.Brep()
    topSurface = Rhino.Geometry.Brep()
    
    # Get faces from breps
    for i, face in enumerate(brep.Faces):
        # Evaluate Surface
        vec = face.NormalAt(0.5,0.5)
        
        # Check if normal is pointing up or down within tolerance
        if vec.Z <= 0 + tol and vec.Z >= 0 - tol:
            b = Rhino.Geometry.BrepFace.DuplicateFace(face,False)
            
            # Append to vertical
            verticalSurfaces.append(b)
        
        elif vec.Z <= 0:
            # Append top master list of top brep
            bottomSurface = face
  
        elif vec.Z >= 0:
            # Append top master list of top brep
            topSurface = face
    
    
    # Join vertical surface
    band = Rhino.Geometry.Brep.JoinBreps(verticalSurfaces,0.01)

    joinedVerticalSurfaces = []
    if len(band) == 1:
        joinedVerticalSurfaces.append(band)
    else:
        for ban in band:
            joinedVerticalSurfaces.append(ban)

    return joinedVerticalSurfaces, bottomSurface, topSurface


def OffsetJoinedBreps(brep,offsetDis):
    
    if offsetDis != 0.0:
        offsetBrep = Rhino.Geometry.Brep.CreateOffsetBrep(brep,offsetDis,False,True,False,0.01)
        return offsetBrep[0][0]
    else:
        return brep


if not Tolerance:
    Tolerance = 0.01
if not OffsetDistance:
    OffsetDistance = 0.0

if CappedBreps:
    
    VerticalSurfaces = []
    TopSurface = []
    BottomSurface = []

    for b in CappedBreps:
        
        vS, tS, bS = unCapBrep(b,Tolerance)
        print(len(vS))
        # save surfaces
        if len(vS) == 1:
            VerticalSurfaces.append(OffsetJoinedBreps(vS[0][0],-1*OffsetDistance))
        else:
            for v in vS:
                VerticalSurfaces.append(OffsetJoinedBreps(v,-1*OffsetDistance))
        TopSurface.append(tS)
        BottomSurface.append(bS)
# ---------- end ub ----------
brep_2 = Brep(ub.VerticalSurfaces)

panel = Panel(ub.VerticalSurfaces)
brep_3 = Brep(brep_2)
path = FilePath("C:\Users\karimd\source\repos\FacadeManager\FM-Python\src\FM-CreatePanels.py")
file = ReadFile(F=path, PerLineParse=False)  # -> C
#   port F: Uri of file to read
# ---------- file: VB line parser ----------
    action = GH_LineParserAction.Include
    Return line

    'Parse the line and return some data that represents the line.
    'If the line cannot be parsed, you can return Nothing and
    'assign a different action.
    'The default implementation is to just return the line itself.
    'If you return types that implement IGH_Goo, this component
    'will work substantially faster.
# ---------- end file ----------

fm_createpanels = FMCreatePanels(
    Code=file,
    Breps=brep_3,
    GridSize=Slider(2.5, range=0..10),
    GroundFloorHeight=Slider(4.79, range=3..10),
    FloorHeight=Slider(3, range=3..10))  # -> Out, A, MeshPanels; "FM-CP"

panel_2 = Panel(fm_createpanels.Out)

# ---- group: Recompute Solution
recompute = Button()
rs = RecomputeSolution(Recompute=recompute)
# ---------- rs: Python ----------
"""
Recomputes the Grasshopper solution (ala pressing F5).
    Inputs:
        Recompute: Trigger the component using a False-True Button {item,bool}
    Outputs:
    Remarks:
        Author: Anders Holden Deleuran (BIG IDEAS)
        License:
        Rhino: 6.18.19266.14201
        Version: 191001
"""

ghenv.Component.Name = "RecomputeSolution"
ghenv.Component.NickName = "RS"

if Recompute:
    def recomputeCanvas(e):
        for obj in ghenv.Component.OnPingDocument().Objects:
            if not obj.InstanceGuid == ghenv.Component.InstanceGuid:
                obj.ExpireSolution(False)
                
    ghenv.Component.OnPingDocument().ScheduleSolution(1000,recomputeCanvas)
# ---------- end rs ----------

# ----
panel_3 = Panel(fm_createpanels.A)
